# Grasshopper definition ExposureRates3D.gh (Grasshopper 1.0.7)
# plug-ins: UrbanXTools

细分程度 = Slider(10, range=0..100)

# ----
# 观测点参数调整
纵轴细分 = Slider(10, range=0..100)
横轴细分 = Slider(40, range=0..100)
观测角度 = Slider(45, range=0..100)
观测范围 = Slider(300, range=0..1000)

# ----
# 建筑体块
brep = Brep([<brep referenced from the Rhino model> x188])

# ----
# 设计路网
curve = Curve([<curve referenced from the Rhino model> x219])
discontinuity = Discontinuity(Curve=curve, Level=1)  # -> Points, Parameters

# ----
# 观测点
point = Point(discontinuity.Points)

urban_spatial_analysis_generatemesh = Urban_Spatial_Analysis_GenerateMesh(Brep=brep, SubdivisionSize=细分程度)
urban_spatial_analysis_exposurerate3d = Urban_Spatial_Analysis_ExposureRate3D(
    ViewPt=flatten(point),
    GeneratedMeshClass=urban_spatial_analysis_generatemesh,
    SubVertical=纵轴细分,
    SubHorizontal=横轴细分,
    ViewRange=观测范围,
    ViewAngle=观测角度)  # -> ColoredSidesMesh, ColoredTopBtnMesh, Ratio
